# Grasshopper definition 00_Geometry entities.gh (Grasshopper 0.9.76)
# Copyright: Co-de-iT
# plug-ins: Human

# geometry
geo = Geometry()
# point
pt = Point(<point referenced from the Rhino model>)
pt_2 = Point([<point referenced from the Rhino model> x4])
# curve
crv = Curve(<curve referenced from the Rhino model>)
crv_2 = Curve(<curve referenced from the Rhino model>)
# surface
srf = Surface(<surface referenced from the Rhino model>)
srf_2 = Surface(<surface referenced from the Rhino model>)
srf_3 = Surface(<surface referenced from the Rhino model>)
# BRep
brep = Brep(<brep referenced from the Rhino model>)
brep_2 = Brep(<brep referenced from the Rhino model>)
# mesh
mesh = Mesh(<mesh referenced from the Rhino model>)
srf_4 = Surface(<surface referenced from the Rhino model>)
# input
# parameters
# parameter
ln = Line()
# GH intro 00
# 
# intro to Grasshopper basic logics
# 
# code by Alessio Erioli
# 
# v 01
# 
# © Co-de-iT 2017 _ Creative Commons Attribution-NonCommercial-ShareAlike 4.0 International License
# output
pt_3 = Point()
Z = UnitZ(Factor=Slider(28.25, range=0..100))
topology = BrepTopology(Brep=brep, PerspectiveOnly=False)  # -> FaceFaceAdjacency, FaceEdgeAdjacency, EdgeFaceAdjacency
debrep = DeconstructBrep(Brep=brep_2)  # -> Faces, Edges, Vertices
md_slider = MDSlider(
    slider_value=Point(0.7682926829, 0.6853652582, 0.5),
    SliderMode=0,
    x_domain=Domain(0, 1),
    y_domain=Domain(0, 1),
    z_domain=Domain(0, 1))
# panel
panel = Panel("""0
0.1
0.4
0.6
0.8
1""")
# component
num = Number(1)
number_slider = Slider(0.393, range=0..1)
# O
# reparametrize
crv_3 = Curve(reparameterize(<curve referenced from the Rhino model>))
pt_4 = Point(<point referenced from the Rhino model>)
pt_5 = Point(<point referenced from the Rhino model>)
pt_6 = Point([<point referenced from the Rhino model> x4])
pt_7 = Point([<point referenced from the Rhino model> x6])
srf_5 = Surface(reparameterize([srf, srf_2, srf_3, srf_4]))
move = Move(Geometry=crv_2, Motion=Z)  # -> Geometry, Transform
# primitives
panel_2 = Panel("some text")
lng = ListLength(List=debrep.Faces)
# linea da coppia di punti
ln_2 = Line(StartPoint=pt_4, EndPoint=pt_5)
# linee da coppie di punti
# criterio della longest list
ln_3 = Line(StartPoint=pt_7, EndPoint=pt_6)
area = Area(Geometry=move.Geometry)  # -> Area, Centroid
wheel = ColourWheel(
    lng,
    ColourGrips_Style=10,
    ColourGrips_Grip=[3.332490635, 2.094395102, 4.188790205, 3.141592654],
    ColourGrips_Lum=[0.4279293869, 0.9209413784],
    ColourGrips_Range=[0.4924539831, 0.4924539831, 0.4924539831, 0.4924539831],
    ColourGrips_Sat=[0.1203673722, 0.6146156123])
evalsrf = EvaluateSurface(Surface=srf_5, Point=md_slider)  # -> Point, Normal, Frame
srfpt = SurfacePoints(Surface=srf_5)  # -> Points, Weights, Greville, UCount, VCount
# evaluate curve
eval = EvaluateCurve(Curve=crv_3, Parameter=number_slider)  # -> Point, Tangent, Angle
# curve domain
domain = Domain(crv_3)
txt = Text(panel_2)
int = Integer("1")
num_2 = Number("0.232554")
bool = Boolean("True")
data = Data([panel_2, "1", "0.232554", "True"])
merge = Merge(Data1=number_slider, Data2=eval.Tangent)
scale = Scale(Geometry=move.Geometry, Center=area.Centroid, Factor=Slider(1.816, range=0.001..2))  # -> Geometry, Transform
# longest list
panel_3 = Panel(domain)
triminc = PointInTrim(Surface=srf_4, UVPoint=evalsrf.Point)
Z_2 = UnitZ(Factor=Slider(41.05, range=0.001..100))
punto_x_y_z = Panel(eval.Point)
vettore_tangente = Panel(eval.Tangent)
join = TextJoin(Text=merge)
previewmat = CustomPreviewMaterials(Geometry=debrep.Faces, DiffuseColor=wheel)
move_2 = Move(Geometry=scale.Geometry, Motion=Z_2)  # -> Geometry, Transform
tag = TextTag3D(Location=eval.Point, Text=join, Size=1, Justification=7)
# creazione rapida di:
# panels
# < doppio click su canvas + digitare "
# testo
# test-o
# < doppio click su canvas + digitare scr
# < sketch
panel_4 = Panel("annotazione (panel)")
merge_2 = Merge(Data1=crv_2, Data2=scale.Geometry, Data3=move_2.Geometry)
loft = Loft(Curves=merge_2, Options={Adjust=False, Closed=False, LoftEnds=0, LoftSimp=0, LoftType=0, Rebuild=10, Refit=0.01})
previewmat_2 = CustomPreviewMaterials(Geometry=loft, DiffuseColor=RGB(255, 255, 255))

# ----
# sliders
# 0<5<10
# 4
# 15
# 0<<10
# 0<10
# 0<<1
number_slider_2 = Slider(5, range=0..10)
number_slider_3 = Slider(15, range=0..100)
number_slider_4 = Slider(10, range=0..10)
number_slider_5 = Slider(0, range=0..10)
number_slider_6 = Slider(0.25, range=0..1)
# < doppio click su canvas + digitare testo a fianco degli sliders
number_slider_7 = Slider(4, range=0..10)
