# Grasshopper definition 02-1_lists basics-extended.gh (Grasshopper 0.9.76)
# Copyright: Co-de-iT

# Lists basics extended
# 
# basic lists operations - almost all of them
# 
# code by Alessio Erioli
# 
# v 0.1
# 
# © Co-de-iT 2017 _ Creative Commons Attribution-NonCommercial-ShareAlike 4.0 International License
# 01 basic operations
# list item
series = Series(Start=0, Step=1, Count=10)
# merge
panel = Panel("5")
# dispatch/weave
series_2 = Series(Start=0, Step=1, Count=10)
panel_2 = Panel(series)
# split list
series_3 = Series(Start=0, Step=1, Count=10)
# sub list
series_4 = Series(Start=0, Step=1, Count=10)
# sort list
panel_3 = Panel("0 to 100")
# sift/combine
series_5 = Series(Start=0, Step=1, Count=10)
# insert/replace items
series_6 = Series(Start=0, Step=1, Count=10)
# shift list
series_7 = Series(Start=0, Step=1, Count=10)
series_8 = Series(Start="11", Step="10", Count=10)
# pick'n'choose
series_9 = Series(Start=0, Step=1, Count=10)
# partition list
series_10 = Series(Start=0, Step=1, Count=10)
panel_4 = Panel(series_3)
panel_5 = Panel(series_4)
panel_6 = Panel(series_5)
panel_7 = Panel(series_6)
panel_8 = Panel(series_2)
series_11 = Series(Start=0, Step=1, Count=panel)
series_12 = Series(Start=panel, Step=1, Count=panel)
panel_9 = Panel(series_7)
wrap = BooleanToggle(False)
# split list
# 
# spezza la lista in due all'indice fornito
number_slider = Slider(3, range=0..9)
panel_10 = Panel(series_9)
panel_11 = Panel(series_8)
random = Random(Range=panel_3, Number="10", Seed=2, Integers=True)
panel_12 = Panel(series_10)
domain_start = Slider(2, range=0..9)
panel_13 = Panel(series_11)
panel_14 = Panel(series_12)
domain_start_2 = Slider(6, range=0..9)
number_slider_2 = Slider(0, range=0..20)
panel_15 = Panel("""0
0
1
1""")
wrap_2 = BooleanToggle(False)
# dispatch
# 
# reindirizza l'input su due canali (A, B)
# a seconda di un pattern di valori
# booleani (true, false)
# per creare un panel con dati su più righe
# cliccare con il tasto dx del mouse
# e deselezionare "multiline data"
panel_16 = Panel("""false
true""")
item = ListItem(List=series, Index=Slider(0, range=0..20), Wrap=wrap)

item_2 = ListItem(List=series, Index="0", Wrap="true")
item_3 = ListItem(List=series, Index="-1", Wrap="true")

panel_17 = Panel(random)

sift = SiftPattern(List=series_5, SiftPattern=panel_15)  # -> Output0, Output1
# combine data
# 
# combina i dati da vari canali di input
# seguendo il pattern P
# Avvicinandosi al componente si
# possono aggiungere dinamicamente
# nuovi canali
combine = CombineData(Input0=sift.Output0, Input1=sift.Output1)  # -> Result, Index

series_13 = Series(Start=0, Step=1, Count="10")
wrap_3 = BooleanToggle(False)
merge = Merge(Data1=series_11, Data2=series_12)
# NOTA
# 
# con l'opzione Wrap attivata, gli indici
# positivi scorrono la lista in un senso e
# gli indici negativi nel senso opposto.
# 
# Es: 0 è il primo elemento, -1 è l'ultimo
panel_18 = Panel(item_2)
panel_19 = Panel(item_3)
split = SplitList(List=series_3, Index=number_slider)  # -> ListA, ListB
sort = SortList(Keys=random, ValuesA=series_13)  # -> Keys, ValuesA
random_2 = Random(Range=Domain(0, 1), Number=Slider(8, range=1..20), Seed=2, Integers=True)
# shift list
# 
# fa scorrere gli elementi della lista L della quantità S.
# 
# S può essere positiva o negativa, il segno
# indica il verso di scorrimento.
# 
# L'opzione Wrap (attiva di default) rende
#  la lista circolare (simile ad un orologio,
# in cui dopo le 12 si ricomincia da 1)
# 
# Provare ad attivare/disattivare l'opzione
# Wrap per S > 0
shift = ShiftList(List=series_7, Shift=Slider(-2, range=-9..9), Wrap=wrap_2)
panel_20 = Panel(sift.Output0)
# sift
# 
# setaccia la lista e la separa nei vari
# canali di output seguendo il pattern P
# Avvicinandosi al componente si
# possono aggiungere dinamicamente
# nuovi canali
panel_21 = Panel(sift.Output1)
dom = ConstructDomain(DomainStart=domain_start, DomainEnd=domain_start_2)
dispatch = Dispatch(List=series_2, DispatchPattern=panel_16)  # -> ListA, ListB
panel_22 = Panel(merge)
# per dare un titolo al panel
# cliccare sul panel con il
# tasto destro del mouse e
# scrivere nel campo in alto
# del menu contestuale
# list item
# 
# estrae l'elemento di indice i della lista L
# 
# L'opzione Wrap (attiva di default) rende
#  la lista circolare (simile ad un orologio,
# in cui dopo le 12 si ricomincia da 1)
# 
# Provare ad attivare/disattivare l'opzione
# Wrap con un indice superiore al numero
# dei dati
element = Panel(item)
# partition list
# 
# ripartisce la lista in sotto liste seguendo
# la sequenza S. La sequenza indica
# il numero di elementi per ciascuna
# sotto lista e si ripete fino ad esaurimento
# lista
# per creare un panel con dati su più righe
# cliccare con il tasto dx del mouse
# e deselezionare "multiline data"
panel_23 = Panel("""3
2
1""")

ins = InsertItems(List=series_6, Item="42", Indices=number_slider_2, Wrap=wrap_3)
replace = ReplaceItems(List=series_6, Item="42", Indices=number_slider_2, Wrap=wrap_3)

int = Integer(sort.ValuesA)
# pick'n'choose
# 
# utilizza un pattern di indici (P) per
# comporre una lista prendendo elementi
# dai rispettivi canali di input
p_n_c = PickNChoose(Pattern=random_2, Stream0=series_9, Stream1=series_8)
subset = SubList(List=series_4, Domain=dom, Wrap=True)  # -> List, Index
panel_24 = Panel(shift)
panel_25 = Panel(sort.Keys)
panel_26 = Panel(dispatch.ListA)
# sort list
# 
# Ordina la lista di oggetti A secondo il
# parametro K (per ogni A deve esistere
# un parametro K misurabile - es. numero).
# Posso usare solo k se devo ordinare dei numeri
panel_27 = Panel(int)
panel_28 = Panel(dispatch.ListB)
partition = PartitionList(List=series_10, Size=panel_23)
panel_29 = Panel(random_2)
panel_30 = Panel(p_n_c)
# insert item
# 
# inserisce l'elemento I all'indice i della lista L
# 
# L'opzione Wrap (attiva di default) rende
#  la lista circolare (simile ad un orologio,
# in cui dopo le 12 si ricomincia da 1)
# 
# Provare ad attivare/disattivare l'opzione
# Wrap con un indice superiore al numero
# di elementi
insert = Panel(ins)
# Replace items
# 
# sostituisce l'elemento I all'indice i della lista L
# 
# L'opzione Wrap (attiva di default) rende
#  la lista circolare (simile ad un orologio,
# in cui dopo le 12 si ricomincia da 1)
# 
# Provare ad attivare/disattivare l'opzione
# Wrap con un indice superiore al numero
# di elementi
replace_2 = Panel(replace)
list_a = Panel(split.ListA)
list_b = Panel(split.ListB)
items = Panel(subset.List)
# sub list
# 
# estrae una sotto-lista nel range di indici
# indicato all'input D
indices = Panel(subset.Index)
# weave
# 
# intreccia l'input da due canali (0, 1)
# a seconda di un pattern di valori
# booleani (true, false). La corrispondenza
# è:
# 0 = false
# 1 = true
weave = Weave(Pattern=panel_16, Stream0=dispatch.ListB, Stream1=dispatch.ListA, NullGaps=False)
panel_31 = Panel(combine.Index)
panel_32 = Panel(combine.Result)
panel_33 = Panel(partition)
panel_34 = Panel(weave)
division_pts = Slider(64, range=2..150)
# 02 examples
crv = Curve(<curve referenced from the Rhino model>)
crv_2 = Curve(<curve referenced from the Rhino model>)
crv_3 = Curve(<curve referenced from the Rhino model>)
crv_4 = Curve(<curve referenced from the Rhino model>)
division_pts_2 = Slider(150, range=2..150)
pt = Point([Point(69, 51, 11.48105052), Point(68.96666667, 49.4, 11.40706153), Point(68.93333333, 47.8, 11.19529993), Point(68.9, 46.2, 10.86107379), Point(68.86666667, 44.6, 10.41969118), Point(68.83333333, 43, 9.886460168)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])
crv_5 = Curve(<curve referenced from the Rhino model>)
crv_6 = Curve(<curve referenced from the Rhino model>)
number_slider_3 = Slider(176, range=2..200)
division_pts_3 = Slider(64, range=2..150)
domain_start_3 = Slider(20, range=2..150)
domain_end = Slider(36, range=2..150)
crv_7 = Curve(<curve referenced from the Rhino model>)
# indice dinamico:
# in questo modo l'indice non eccede mai
# il valore nell'input B
number_slider_4 = Slider(0.521, range=0..1)
division_pts_4 = Slider(64, range=2..150)
pdecon = Deconstruct(Point=pt)  # -> XComponent, YComponent, ZComponent
crv_8 = Curve(<curve referenced from the Rhino model>)
divide = DivideCurve(Curve=crv, Count=division_pts, Kinks=False)  # -> Points, Tangents, Parameters
wrap_4 = BooleanToggle(True)
item_index = Slider(27, range=0..150)
grid_size = Slider(52.533, range=0..100)
y_cells = Slider(46, range=2..200)
x_cells = Slider(46, range=2..200)
division_pts_5 = Slider(64, range=2..150)
pt_2 = Point(<point referenced from the Rhino model>)
crv_9 = Curve(<curve referenced from the Rhino model>)
crv_10 = Curve(<curve referenced from the Rhino model>)
crv_11 = Curve(<curve referenced from the Rhino model>)
crv_12 = Curve(<curve referenced from the Rhino model>)
divide_2 = DivideCurve(Curve=crv_2, Count=division_pts_2, Kinks=False)  # -> Points, Tangents, Parameters
y_cells_2 = Slider(14, range=2..200)
grid_size_2 = Slider(52.533, range=0..100)
x_cells_2 = Slider(54, range=2..200)
divide_3 = DivideCurve(Curve=crv_3, Count=division_pts_2, Kinks=False)  # -> Points, Tangents, Parameters
divide_4 = DivideCurve(Curve=crv_4, Count=division_pts_2, Kinks=False)  # -> Points, Tangents, Parameters
pt_3 = Point(<point referenced from the Rhino model>)
sort_2 = SortList(Keys=pdecon.ZComponent, ValuesA=pt)  # -> Keys, ValuesA
divide_5 = DivideCurve(Curve=crv_6, Count=number_slider_3, Kinks=False)  # -> Points, Tangents, Parameters
divide_6 = DivideCurve(Curve=crv_5, Count=number_slider_3, Kinks=False)  # -> Points, Tangents, Parameters
multiplication = Multiplication(A=number_slider_4, B=division_pts_4)
cp = ControlPoints(Curve=crv_12)  # -> Points, Weights, Knots
divide_7 = DivideCurve(Curve=crv_7, Count=division_pts_3, Kinks=False)  # -> Points, Tangents, Parameters
cp_2 = ControlPoints(Curve=crv_11)  # -> Points, Weights, Knots
neg = Negative(Value=Slider(0, range=0..200))
addition = Addition(A=x_cells_2, B="1")
division = Division(A=grid_size, B=x_cells)
division_2 = Division(A=grid_size, B=y_cells)
divide_8 = DivideCurve(Curve=crv_9, Count=division_pts_5, Kinks=False)  # -> Points, Tangents, Parameters
lng = ListLength(List=divide.Points)
item_4 = ListItem(List=divide.Points, Index=item_index, Wrap=wrap_4)
bnd = Bounds(Numbers=sort_2.Keys)
divide_9 = DivideCurve(Curve=crv_10, Count=division_pts_5, Kinks=False)  # -> Points, Tangents, Parameters
tan_strength_b = Slider(-21.299, range=-100..0)
tan_strength_a = Slider(13.903, range=0..100)
random_3 = Random(Range="0 to 2", Number=division_pts_2, Seed=2, Integers=True)
dom_2 = ConstructDomain(DomainStart=domain_start_3, DomainEnd=domain_end)
division_3 = Division(A=grid_size_2, B=x_cells_2)
entwine = Entwine(Branch00=divide_2.Points, Branch01=divide_3.Points, Branch02=divide_4.Points, FlattenInputs=True)
division_4 = Division(A=grid_size_2, B=y_cells_2)
int_2 = Integer(multiplication)
pframes = PerpFrames(Curve=crv_8, Count=division_pts_4, Align=True)  # -> Frames, Parameters
pt_4 = Point(<point referenced from the Rhino model>)
cir = Circle(Plane=pt_4, Radius=1)
pt_5 = Point(<point referenced from the Rhino model>)

shift_2 = ShiftList(List=divide_5.Points, Shift=neg, Wrap=True)
shift_3 = ShiftList(List=divide_6.Points, Shift=Slider(39, range=0..200), Wrap=True)

dedomain = DeconstructDomain(Domain=bnd)  # -> Start, End
addition_2 = Addition(A=y_cells_2, B="1")
series_14 = Series(Start=0, Step=1, Count=addition)
index = Panel(int_2)
list_length = Panel(lng)
panel_35 = Panel("""5
3
4""")
flip = FlipMatrix(Data=entwine)
recgrid = Rectangular(Plane=pt_2, SizeX=division, SizeY=division_2, ExtentX=x_cells, ExtentY=y_cells)  # -> Cells, Points
ins_2 = InsertItems(List=cp_2.Points, Item=pt_4, Indices=Slider(5, range=0..5), Wrap=True)
cir_2 = Circle(Plane=pt_5, Radius=1)
p_n_c_2 = PickNChoose(Pattern=random_3, Stream0=divide_2.Points, Stream1=divide_3.Points, Stream2=divide_4.Points)  # -> graft(Result)
replace_3 = ReplaceItems(List=cp.Points, Item=pt_5, Indices=Slider(4, range=0..6), Wrap=False)
split_2 = SplitList(List=pframes.Frames, Index=int_2)  # -> ListA, ListB
recgrid_2 = Rectangular(Plane=pt_3, SizeX=division_3, SizeY=division_4, ExtentX=x_cells_2, ExtentY=y_cells_2)  # -> Cells, Points
gradient = Gradient(
    LowerLimit=dedomain.Start,
    UpperLimit=dedomain.End,
    Parameter=sort_2.Keys,
    stops=[0.011: RGB(191, 8, 8), 0.999: RGB(255, 255, 255)])
Z = UnitZ(Factor=1)
ln = Line(StartPoint=shift_2, EndPoint=shift_3)

# ----
# sub list
# 
# estrae una sottolista da una lista L
subset_2 = SubList(List=divide_7.Points, Domain=dom_2, Wrap=True)  # -> List, Index
subset_3 = SubList(List=divide_7.Tangents, Domain=dom_2, Wrap=True)  # -> List, Index

random_4 = Random(Range="0 to 2", Number=addition_2, Seed=series_14, Integers=True)
avr = Average(Input=flip)
X = UnitX(Factor=tan_strength_b)

partition_2 = PartitionList(List=divide_9.Points, Size=panel_35)
partition_3 = PartitionList(List=divide_8.Points, Size=panel_35)
rev = ReverseList(List=partition_3)

pt_6 = Point(<point referenced from the Rhino model>)
points = PointList(Points=ins_2, Size=2)
addition_3 = Addition(A="20", B=grid_size)
points_2 = PointList(Points=replace_3, Size=2)
series_15 = Series(Start=0, Step=1, Count=x_cells)  # -> graft(Series)
polygon = Polygon(Plane=split_2.ListB, Radius="1.5", Segments=6, FilletRadius=0)  # -> Polygon, Length
line = LineSDL(Start=item_4, Direction=Z, Length=Slider(10, range=0..10))
item_5 = ListItem(List=ln, Index=0, Wrap=True)
cir_3 = Circle(Plane=split_2.ListA, Radius="1.5")
random_threshold = Slider(0.84, range=0..1)
multiplication_2 = Multiplication(A=subset_3.List, B=tan_strength_a)
Y = UnitY(Factor=addition_3)
swatch = ColourSwatch(SwatchColor=RGB(255, 255, 255))
nurbs = NurbsCurve(Vertices=ins_2, Degree=3, Periodic=False)  # -> Curve, Length, Domain
pline = PolyLine(Vertices=ins_2, Closed=False)
end = EndPoints(Curve=line)  # -> Start, End
multiplication_3 = Multiplication(A=division_3, B=Slider(0, range=0..1))
lng_2 = ListLength(List=recgrid.Cells)
nurbs_2 = NurbsCurve(Vertices=replace_3, Degree=3, Periodic=False)  # -> Curve, Length, Domain
pline_2 = PolyLine(Vertices=flatten(avr), Closed=False)
pline_3 = PolyLine(Vertices=replace_3, Closed=False)
merge_2 = Merge(Data1=partition_2, Data2=rev)
move = Move(Geometry=recgrid.Cells, Motion=Y)  # -> Geometry, Transform
ln_2 = Line(StartPoint=avr, EndPoint=p_n_c_2)
preview = CustomPreview(Geometry=sort_2.ValuesA, Shader=gradient)
# Bézier span
# 
# per un help più comprensivo,
# cliccare con il tasto dx del mouse
# sulla parte centrale del componente
# e selezionare Help
bzspan = BezierSpan(StartPoint=subset_2.List, StartTangent=multiplication_2, EndPoint=pt_6, EndTangent=X)  # -> Curve, Length, Domain
random_5 = Random(Range=Domain(0, 1), Number=lng_2, Seed=series_15)
preview_2 = CustomPreview(Geometry=item_5, Shader=ColourSwatch(SwatchColor=RGB(255, 255, 255)))
# e questa area colorata?
# Seleziona uno o più componenti,
# poi CTRL+g per creare un gruppo.
# 
# Facendo doppio click all'interno
# dell'area colorata si cambia la forma
# alternando tra 3 tipi possibili
# per trovare chi è e cosa fa
# questo componente (o altri che non
# riconosci) tieni premuto CTRL+ALT
# e clicca con il tasto sx del mouse
# (tenendolo premuto) sul componente
preview_3 = CustomPreview(Geometry=line, Shader=swatch)
tag = TextTag3D(Location=end.End, Text=item_index, Size=1, Colour=swatch, Justification=7)
X_2 = UnitX(Factor=multiplication_3)
X_3 = UnitX(Factor=division_3)
preview_4 = CustomPreview(Geometry=cir_3, Shader=ColourSwatch(SwatchColor=RGB(255, 255, 255)))
explode = Explode(Curve=move.Geometry, Recursive=True)  # -> Segments, Vertices
explode_2 = Explode(Curve=recgrid.Cells, Recursive=True)  # -> Segments, Vertices
dash = DashPattern(Curve=pline, Pattern="1")  # -> Dashes, Gaps
nurbs_3 = NurbsCurve(Vertices=merge_2, Degree=3, Periodic=Toggle(True))  # -> Curve, Length, Domain
smaller = SmallerThan(FirstNumber=random_5, SecondNumber=random_threshold)  # -> graft(SmallerThan), OrEqualTo
dash_2 = DashPattern(Curve=pline_3, Pattern="1")  # -> Dashes, Gaps
crv_13 = Curve([<curve referenced from the Rhino model> x2])
dispatch_2 = Dispatch(List=explode.Vertices, DispatchPattern=smaller.SmallerThan)  # -> ListA, ListB
dispatch_3 = Dispatch(List=explode_2.Vertices, DispatchPattern=smaller.SmallerThan)  # -> ListA, ListB
panel_36 = Panel("""1
2""")
panel_37 = Panel("""0
3""")
panel_38 = Panel("""1
2""")
panel_39 = Panel("""2
3""")
panel_40 = Panel("""0
1""")
panel_41 = Panel("""0
3""")
panel_42 = Panel("""0
2""")
panel_43 = Panel("""1
3""")
divide_10 = DivideCurve(Curve=crv_13, Count=Slider(71, range=2..100), Kinks=False)  # -> Points, Tangents, Parameters
item_6 = ListItem(List=dispatch_2.ListA, Index=panel_37, Wrap=True)
item_7 = ListItem(List=dispatch_2.ListA, Index=panel_38, Wrap=True)
item_8 = ListItem(List=dispatch_2.ListA, Index=panel_39, Wrap=True)
item_9 = ListItem(List=dispatch_2.ListA, Index=panel_40, Wrap=True)
item_10 = ListItem(List=dispatch_2.ListB, Index=panel_41, Wrap=True)
item_11 = ListItem(List=dispatch_2.ListB, Index=panel_36, Wrap=True)
item_12 = ListItem(List=dispatch_3.ListA, Index=panel_42, Wrap=True)
item_13 = ListItem(List=dispatch_3.ListB, Index=panel_43, Wrap=True)

curvature = Curvature(Curve=graft(crv_13), Parameter=divide_10.Parameters)  # -> P, K, C
darc = DeconstructArc(Arc=curvature.C)  # -> BasePlane, Radius, Angle
# i punti vengono spostati lungo la
# rispettiva direzione di curvatura
# in modo proporzionale alla
# curvatura stessa
bnd_2 = Bounds(Numbers=darc.Radius)
# K
remap = RemapNumbers(Value=darc.Radius, Source=bnd_2, Target=Domain(0, 1))  # -> Mapped, Clipped
multiplication_4 = Multiplication(A=Slider(4.818, range=0.1..20), B=remap.Mapped)
amp = Amplitude(Vector=curvature.K, Amplitude=multiplication_4)

avr_2 = Average(Input=item_6)
avr_3 = Average(Input=item_7)
pline_4 = PolyLine(Vertices=item_8, Closed=False)  # -> flatten(Polyline)
pline_5 = PolyLine(Vertices=item_9, Closed=False)  # -> flatten(Polyline)
pline_6 = PolyLine(Vertices=item_10, Closed=False)  # -> flatten(Polyline)
pline_7 = PolyLine(Vertices=item_11, Closed=False)  # -> flatten(Polyline)
pline_8 = PolyLine(Vertices=item_12, Closed=False)  # -> flatten(Polyline)
pline_9 = PolyLine(Vertices=item_13, Closed=False)  # -> flatten(Polyline)
ln_3 = Line(StartPoint=avr_2, EndPoint=avr_3)  # -> flatten(Line)
weave_2 = Weave(Pattern=flatten(smaller.SmallerThan), Stream0=[pline_6, pline_7], Stream1=[pline_5, pline_4, ln_3], NullGaps=False)
weave_3 = Weave(Pattern=flatten(smaller.SmallerThan), Stream0=pline_9, Stream1=pline_8, NullGaps=False)
multiplication_5 = Multiplication(A=Y, B=2)
move_2 = Move(Geometry=pt_2, Motion=multiplication_5)  # -> Geometry, Transform
preview_5 = CustomPreview(Geometry=weave_2, Shader=ColourSwatch(SwatchColor=RGB(94, 94, 94)))
preview_6 = CustomPreview(Geometry=weave_3, Shader=ColourSwatch(SwatchColor=RGB(0, 0, 0)))
grid_size_3 = Slider(52.533, range=0..100)
x_cells_3 = Slider(46, range=2..200)
y_cells_3 = Slider(46, range=2..200)
pt_7 = Point(<point referenced from the Rhino model>)
# T
move_3 = Move(Geometry=divide_10.Points, Motion=amp)  # -> Geometry, Transform
flip_2 = FlipMatrix(Data=move_3.Geometry)
flip_3 = FlipMatrix(Data=divide_10.Points)
num = Number(grid_size)
pt_8 = Point(move_2.Geometry)
x_cells_4 = Slider(87, range=2..200)
y_cells_4 = Slider(87, range=2..200)
division_5 = Division(A=grid_size_3, B=x_cells_3)
division_6 = Division(A=grid_size_3, B=y_cells_3)
pline_10 = PolyLine(Vertices=flip_3, Closed=False)  # -> flatten(Polyline)
pline_11 = PolyLine(Vertices=flip_2, Closed=False)  # -> flatten(Polyline)
recgrid_3 = Rectangular(Plane=pt_7, SizeX=division_5, SizeY=division_6, ExtentX=x_cells_3, ExtentY=y_cells_3)  # -> Cells, Points
shift_4 = ShiftList(List=pline_11, Shift=1, Wrap=True)  # -> flatten(List)
division_7 = Division(A=num, B=y_cells_4)
division_8 = Division(A=num, B=x_cells_4)
rectangle = Rectangle(Plane=pt_8, XSize=num, YSize=num, Radius=0)  # -> Rectangle, Length
merge_3 = Merge(Data1=graft(pline_10), Data2=graft(pline_11))
merge_4 = Merge(Data1=graft(pline_10), Data2=graft(shift_4))
lng_3 = ListLength(List=flatten(recgrid_3.Cells))
pcen = PolygonCenter(Polyline=rectangle.Rectangle)  # -> CenterV, CenterE, CenterA
explode_3 = Explode(Curve=recgrid_3.Cells, Recursive=True)  # -> Segments, Vertices
panel_44 = Panel("""1
3""")
panel_45 = Panel("""0
2""")
recgrid_4 = Rectangular(Plane=pt_8, SizeX=division_8, SizeY=division_7, ExtentX=x_cells_4, ExtentY=y_cells_4)  # -> Cells, Points
random_threshold_2 = Slider(0.052, range=0..1)
scale = Scale(Geometry=rectangle.Rectangle, Center=pcen.CenterV, Factor=Slider(0.969, range=0..1))  # -> Geometry, Transform
random_6 = Random(Range=Domain(0, 1), Number=lng_3, Seed=2)
item_14 = ListItem(List=explode_3.Vertices, Index=panel_45, Wrap=True)
item_15 = ListItem(List=explode_3.Vertices, Index=panel_44, Wrap=True)
loft = Loft(Curves=merge_3, Options={Adjust=False, Closed=False, LoftEnds=0, LoftSimp=0, LoftType=3, Rebuild=10, Refit=0.01})
loft_2 = Loft(Curves=merge_4, Options={Adjust=False, Closed=False, LoftEnds=0, LoftSimp=0, LoftType=3, Rebuild=10, Refit=0.01})
pop2d = Populate2D(Region=scale.Geometry, Count=Slider(3, range=3..40), Seed=Slider(30, range=1..100))
panel_46 = Panel("0.5")
pcen_2 = PolygonCenter(Polyline=recgrid_4.Cells)  # -> CenterV, CenterE, CenterA
pline_12 = PolyLine(Vertices=item_14, Closed=False)  # -> flatten(Polyline)
pline_13 = PolyLine(Vertices=item_15, Closed=False)  # -> flatten(Polyline)
smaller_2 = SmallerThan(FirstNumber=random_6, SecondNumber=random_threshold_2)  # -> SmallerThan, OrEqualTo
# loft delle congiungenti dei punti sulle curve
# con i segmenti spostati lungo la curvatura
# alla posizione +1
preview_7 = CustomPreview(Geometry=loft_2, Shader=ColourSwatch(SwatchColor=RGB(168, 135, 0)))
# loft delle congiungenti dei punti sulle curve
# con le corrispondenti spostate lungo la curvatura
preview_8 = CustomPreview(Geometry=loft, Shader=ColourSwatch(SwatchColor=RGB(255, 255, 255)))
fspin = SpinForce(Plane=pop2d, Strength=1, Radius=Slider(20.09, range=0..50), Decay=2)
mergef = MergeFields(Fields=fspin)
evf = EvaluateField(Field=mergef, Point=pcen_2.CenterV)  # -> Tensor, Strength
p_n_c_3 = PickNChoose(Pattern=smaller_2.SmallerThan, Stream0=pline_12, Stream1=pline_13)
unit = UnitVector(Vector=evf.Tensor)
pdecon_2 = Deconstruct(Point=unit)  # -> XComponent, YComponent, ZComponent
preview_9 = CustomPreview(Geometry=p_n_c_3, Shader=ColourSwatch(SwatchColor=RGB(0, 0, 0)))
vdisex = VectorDisplayEx(Point=pcen_2.CenterV, Vector=evf.Tensor, Colour=ColourSwatch(SwatchColor=RGB(9, 76, 97)), Width=1)
abs = Absolute(Value=pdecon_2.XComponent)
explode_4 = Explode(Curve=recgrid_4.Cells, Recursive=True)  # -> Segments, Vertices
larger = LargerThan(FirstNumber=abs, SecondNumber=Slider(0.5, range=0..1))  # -> graft(LargerThan), OrEqualTo
dispatch_4 = Dispatch(List=explode_4.Vertices, DispatchPattern=larger.LargerThan)  # -> ListA, ListB
panel_47 = Panel("""1
2""")
panel_48 = Panel("""0
3""")
panel_49 = Panel("""2
3""")
panel_50 = Panel("""0
1""")
item_16 = ListItem(List=dispatch_4.ListB, Index=panel_47, Wrap=True)
item_17 = ListItem(List=dispatch_4.ListB, Index=panel_48, Wrap=True)
item_18 = ListItem(List=dispatch_4.ListA, Index=panel_49, Wrap=True)
item_19 = ListItem(List=dispatch_4.ListA, Index=panel_50, Wrap=True)
pline_14 = PolyLine(Vertices=item_16, Closed=False)
pline_15 = PolyLine(Vertices=item_17, Closed=False)
pline_16 = PolyLine(Vertices=item_18, Closed=False)
pline_17 = PolyLine(Vertices=item_19, Closed=False)
merge_5 = Merge(Data1=pline_17, Data2=pline_16)  # -> flatten(Result)
merge_6 = Merge(Data1=pline_15, Data2=pline_14)  # -> flatten(Result)
move_4 = Move(Geometry=pt_8, Motion=Y)  # -> Geometry, Transform
preview_10 = CustomPreview(Geometry=[merge_5, merge_6], Shader=ColourSwatch(SwatchColor=RGB(0, 0, 0)))
num_2 = Number(grid_size)
pt_9 = Point(move_4.Geometry)
x_cells_5 = Slider(87, range=2..200)
y_cells_5 = Slider(87, range=2..200)
rectangle_2 = Rectangle(Plane=pt_9, XSize=num_2, YSize=num_2, Radius=0)  # -> Rectangle, Length
pcen_3 = PolygonCenter(Polyline=rectangle_2.Rectangle)  # -> CenterV, CenterE, CenterA
division_9 = Division(A=num_2, B=y_cells_5)
division_10 = Division(A=num_2, B=x_cells_5)
scale_2 = Scale(Geometry=rectangle_2.Rectangle, Center=pcen_3.CenterV, Factor=Slider(1.125, range=0.5..2))  # -> Geometry, Transform
recgrid_5 = Rectangular(Plane=pt_9, SizeX=division_10, SizeY=division_9, ExtentX=x_cells_5, ExtentY=y_cells_5)  # -> Cells, Points
pcen_4 = PolygonCenter(Polyline=recgrid_5.Cells)  # -> CenterV, CenterE, CenterA
pop2d_2 = Populate2D(Region=scale_2.Geometry, Count=Slider(5, range=3..40), Seed=Slider(16, range=1..100))
nurbs_4 = NurbsCurve(Vertices=pop2d_2, Degree=3, Periodic=False)  # -> Curve, Length, Domain
crv_cp = CurveClosestPoint(Point=pcen_4.CenterV, Curve=nurbs_4.Curve)  # -> Point, Parameter, Distance
field_threshold = Slider(0.5, range=0..1)
curve_dist_threshold = Slider(3.15, range=0..10)
eval = EvaluateCurve(Curve=nurbs_4.Curve, Parameter=crv_cp.Parameter)  # -> Point, Tangent, Angle
field_threshold_2 = Slider(0.5, range=0..1)
vec2pt = Vector2Pt(PointA=pcen_4.CenterV, PointB=crv_cp.Point, Unitize=True)  # -> Vector, Length
pi = Pi(Factor=1)
pdecon_3 = Deconstruct(Point=eval.Tangent)  # -> XComponent, YComponent, ZComponent
Z_2 = UnitZ(Factor=1)
multiplication_6 = Multiplication(A=pi, B=Slider(0.5, range=0..0.5))
abs_2 = Absolute(Value=pdecon_3.XComponent)
vrot = Rotate(Vector=vec2pt.Vector, Axis=Z_2, Angle=multiplication_6)
pdecon_4 = Deconstruct(Point=vrot)  # -> XComponent, YComponent, ZComponent
abs_3 = Absolute(Value=pdecon_4.XComponent)
scenario = ValueList({"field": 0, "curve field": 1, "curve distance": 2}, selected="curve distance")
smaller_3 = SmallerThan(FirstNumber=crv_cp.Distance, SecondNumber=curve_dist_threshold)  # -> graft(SmallerThan), OrEqualTo
larger_2 = LargerThan(FirstNumber=abs_3, SecondNumber=field_threshold)  # -> graft(LargerThan), OrEqualTo
explode_5 = Explode(Curve=recgrid_5.Cells, Recursive=True)  # -> Segments, Vertices
larger_3 = LargerThan(FirstNumber=abs_2, SecondNumber=field_threshold_2)  # -> graft(LargerThan), OrEqualTo
vdisex_2 = VectorDisplayEx(Point=pcen_4.CenterV, Vector=eval.Tangent, Colour=ColourSwatch(SwatchColor=RGB(197, 224, 232)), Width=1)
filter = StreamFilter(Gate=scenario, Stream0=larger_2.LargerThan, Stream1=larger_3.LargerThan, Stream2=smaller_3.SmallerThan)
dispatch_5 = Dispatch(List=explode_5.Vertices, DispatchPattern=filter)  # -> ListA, ListB
panel_51 = Panel("""2
3""")
panel_52 = Panel("""0
1""")
panel_53 = Panel("""1
2""")
panel_54 = Panel("""0
3""")
item_20 = ListItem(List=dispatch_5.ListA, Index=panel_51, Wrap=True)
item_21 = ListItem(List=dispatch_5.ListA, Index=panel_52, Wrap=True)
item_22 = ListItem(List=dispatch_5.ListB, Index=panel_53, Wrap=True)
item_23 = ListItem(List=dispatch_5.ListB, Index=panel_54, Wrap=True)
pline_18 = PolyLine(Vertices=item_20, Closed=False)
pline_19 = PolyLine(Vertices=item_21, Closed=False)
pline_20 = PolyLine(Vertices=item_22, Closed=False)
pline_21 = PolyLine(Vertices=item_23, Closed=False)
merge_7 = Merge(Data1=pline_19, Data2=pline_18)  # -> flatten(Result)
merge_8 = Merge(Data1=pline_21, Data2=pline_20)  # -> flatten(Result)
preview_11 = CustomPreview(Geometry=[merge_7, merge_8], Shader=ColourSwatch(SwatchColor=RGB(0, 0, 0)))

sift_2 = SiftPattern(List=recgrid_2.Points, SiftPattern=random_4)  # -> Output0, Output1, Output2

move_5 = Move(Geometry=sift_2.Output1, Motion=X_2)  # -> Geometry, Transform
move_6 = Move(Geometry=sift_2.Output2, Motion=X_3)  # -> Geometry, Transform

combine_2 = CombineData(Input0=sift_2.Output0, Input1=move_5.Geometry, Input2=move_6.Geometry)  # -> Result, Index

pline_22 = PolyLine(Vertices=combine_2.Result, Closed=False)  # -> flatten(Polyline)
fillet = Fillet(Curve=pline_22, Radius=Slider(2, range=0..5))
