# Grasshopper definition 02_lists basics.gh (Grasshopper 0.9.76)
# Copyright: Co-de-iT
# plug-ins: Human

# Lists basics extended
# 
# basic lists operations - almost all of them
# 
# code by Alessio Erioli
# 
# v 0.1
# 
# © Co-de-iT 2017 _ Creative Commons Attribution-NonCommercial-ShareAlike 4.0 International License
# 01 basic operations
# list item
series = Series(Start=0, Step=1, Count=10)
# merge
panel = Panel("5")
# graft/flatten
series_2 = Series(Start=0, Step=1, Count=10)
panel_2 = Panel(series)
panel_3 = Panel(series_2)
viewer = ParamViewer(series_2)
viewer_2 = ParamViewer(series_2)
series_3 = Series(Start=0, Step=1, Count=panel)
series_4 = Series(Start=panel, Step=1, Count=panel)
wrap = BooleanToggle(False)
panel_4 = Panel(series_3)
panel_5 = Panel(series_4)
data = Data(graft(series_2))
graft = GraftTree(Tree=series_2, IncludeEmptyLists=True, IncludeNullItems=True)
item = ListItem(List=series, Index=Slider(0, range=0..20), Wrap=wrap)

item_2 = ListItem(List=series, Index="0", Wrap="true")
item_3 = ListItem(List=series, Index="-1", Wrap="true")

merge = Merge(Data1=series_3, Data2=series_4)
panel_6 = Panel(graft)
viewer_3 = ParamViewer(graft)
viewer_4 = ParamViewer(graft)
# NOTA
# 
# con l'opzione Wrap attivata, gli indici
# positivi scorrono la lista in un senso e
# gli indici negativi nel senso opposto.
# 
# Es: 0 è il primo elemento, -1 è l'ultimo
panel_7 = Panel(item_2)
panel_8 = Panel(item_3)
panel_9 = Panel(merge)
# per dare un titolo al panel
# cliccare sul panel con il
# tasto destro del mouse e
# scrivere nel campo in alto
# del menu contestuale
# list item
# 
# estrae l'elemento di indice i della lista L
# 
# L'opzione Wrap (attiva di default) rende
#  la lista circolare (simile ad un orologio,
# in cui dopo le 12 si ricomincia da 1)
# 
# Provare ad attivare/disattivare l'opzione
# Wrap con un indice superiore al numero
# dei dati
element = Panel(item)
data_2 = Data(flatten(data))
flatten = FlattenTree(Tree=graft, Path="{0}")
panel_10 = Panel(flatten)
viewer_5 = ParamViewer(flatten)
viewer_6 = ParamViewer(flatten)
number_slider = Slider(10, range=5..10)
division_pts = Slider(64, range=2..150)
# 02 examples
crv = Curve(<curve referenced from the Rhino model>)
pt = Point(Point(54.66481107, 7.395268244, 0))
series_5 = Series(Start=0, Step=Slider(2, range=0..2), Count=number_slider)
divide = DivideCurve(Curve=crv, Count=division_pts, Kinks=False)  # -> Points, Tangents, Parameters
wrap_2 = BooleanToggle(True)
item_index = Slider(27, range=0..150)

X = UnitX(Factor=series_5)
Y = UnitY(Factor=series_5)

addition = Addition(A=X, B=Y)
lng = ListLength(List=divide.Points)
item_4 = ListItem(List=divide.Points, Index=item_index, Wrap=wrap_2)
# attivare graft e/o flatten su questi input
move = Move(Geometry=pt, Motion=addition)  # -> Geometry, Transform
list_length = Panel(lng)
random = Random(Range="0.1 to 2", Number=number_slider, Seed=2)
Z = UnitZ(Factor=1)
cir = Circle(Plane=move.Geometry, Radius=random)
line = LineSDL(Start=item_4, Direction=Z, Length=Slider(10, range=0..10))
swatch = ColourSwatch(SwatchColor=RGB(255, 255, 255))
end = EndPoints(Curve=line)  # -> Start, End
previewlw = CustomPreviewLineweights(Geometry=cir, Shader=ColourSwatch(SwatchColor=RGB(255, 255, 255)), Absolute=False)
# e questa area colorata?
# Seleziona uno o più componenti,
# poi CTRL+g per creare un gruppo.
# 
# Facendo doppio click all'interno
# dell'area colorata si cambia la forma
# alternando tra 3 tipi possibili
# per trovare chi è e cosa fa
# questo componente (o altri che non
# riconosci) tieni premuto CTRL+ALT
# e clicca con il tasto sx del mouse
# (tenendolo premuto) sul componente
preview = CustomPreview(Geometry=line, Shader=swatch)
tag = TextTag3D(Location=end.End, Text=item_index, Size=1, Colour=swatch, Justification=7)
pt_2 = Point(Point(63.58195747, 43.3688185, 0))
series_6 = Series(Start="0.2", Step=Slider(2, range=0..2), Count=10)
Z_2 = UnitZ(Factor=series_6)
move_2 = Move(Geometry=pt_2, Motion=Z_2)  # -> Geometry, Transform

# ----
# attivare graft e/o flatten su questi input
pt_3 = Point(graft(move_2.Geometry))
num = Number(graft(series_6))

multiplication = Multiplication(A=num, B=Slider(0.192, range=0..1))
multiplication_2 = Multiplication(A=multiplication, B=Slider(0.2, range=0..1))
box = CenterBox(Base=pt_3, X=multiplication, Y=multiplication, Z=multiplication_2)
edges = BrepEdges(Brep=box)  # -> Naked, Interior, NonManifold
previewlw_2 = CustomPreviewLineweights(Geometry=edges.Interior, Shader=ColourSwatch(SwatchColor=RGB(0, 0, 0)), Absolute=False)
