# Grasshopper definition 03_curve patterns.gh (Grasshopper 0.9.76)
# Copyright: Co-de-iT

number_slider = Slider(10, range=10..200)
crv = Curve(reparameterize(<curve referenced from the Rhino model>))
pt = Point([<point referenced from the Rhino model> x3])
crv_2 = Curve(<curve referenced from the Rhino model>)
crv_3 = Curve(<curve referenced from the Rhino model>)
crv_4 = Curve(<curve referenced from the Rhino model>)
crv_5 = Curve(<curve referenced from the Rhino model>)
divide = DivideCurve(Curve=crv_3, Count=Slider(96, range=10..200), Kinks=False)  # -> Points, Tangents, Parameters
crv_cp = CurveClosestPoint(Point=divide.Points, Curve=crv_2)  # -> Point, Parameter, Distance
divide_2 = DivideCurve(Curve=crv_5, Count=number_slider, Kinks=False)  # -> Points, Tangents, Parameters
divide_3 = DivideCurve(Curve=crv_4, Count=number_slider, Kinks=False)  # -> Points, Tangents, Parameters
merge = Merge(Data1=Slider(-0.39, range=-1..1), Data2=Slider(-0.39, range=-1..1), Data3=Slider(-0.39, range=-1..1))
merge_2 = Merge(Data1=Slider(0.025, range=-1..1), Data2=Slider(0.024, range=-1..1), Data3=Slider(0.049, range=-1..1))
merge_3 = Merge(Data1=Slider(5.378, range=1..20), Data2=Slider(6.228, range=1..20), Data3=Slider(5.742, range=1..20))
merge_4 = Merge(Data1=graft(divide.Points), Data2=graft(crv_cp.Point))
merge_5 = Merge(Data1=graft(divide_2.Points), Data2=graft(divide_3.Points))
# curve patterns
# 
# generate printing patterns from curves
# 
# code by Alessio Erioli
# 
# v 0.1
# 
# © Co-de-iT 2017 _ Creative Commons Attribution-NonCommercial-ShareAlike 4.0 International License
divide_4 = DivideCurve(Curve=crv, Count=Slider(58, range=10..200), Kinks=False)  # -> graft(Points), graft(Tangents), Parameters
pcharge = PointCharge(Point=pt, Charge=merge, Decay=2)
fspin = SpinForce(Plane=pt, Strength=merge_2, Radius=merge_3, Decay=2)
list = ValueList({"two curves": 0, "inner curve": 1}, selected="inner curve")
mergef = MergeFields(Fields=[pcharge, fspin])
crv_6 = Curve(<curve referenced from the Rhino model>)
filter = StreamFilter(Gate=list, Stream0=merge_5, Stream1=merge_4)
ftensor = TensorDisplay(Field=mergef, Section=crv_6, Samples=1000)
range = Range(Domain=Domain(0, 1), Steps=Slider(20, range=2..50))
fline = FieldLine(Field=mergef, Point=flatten(divide_4.Points), Steps=1000, Accuracy=0.1, Method=3)
interp = InterpolateData(Data=filter, Parameter=range, Interpolation=2)
flip = FlipMatrix(Data=interp)
panel = Panel("""0
-1""")
intcrv = Interpolate(Vertices=flip, Degree=3, Periodic=False, KnotStyle=1)  # -> reparameterize(flatten(Curve)), Length, Domain
subcrv = SubCurve(BaseCurve=reparameterize(fline), Domain=Slider(0.938, range=0..1))
cull_i = CullIndex(List=intcrv.Curve, Indices=panel, Wrap=True)
panel_2 = Panel("""2
1""")
lng = ListLength(List=cull_i)
dash = DashPattern(Curve=subcrv, Pattern=panel_2)  # -> Dashes, Gaps
panel_3 = Panel("""true
false""")
divide_5 = DivideCurve(Curve=cull_i, Count=expr("x*2", Slider(44, range=2..50)), Kinks=False)  # -> Points, Tangents, Parameters
graph = GraphMapper(
    divide_5.Parameters,
    x0=0,
    x1=1,
    y0=0,
    y1=1,
    container_name="Sine",
    Equation_px=[0, 0.2826086879],
    Equation_py=[0, 0.5217391253])
graph_2 = GraphMapper(divide_5.Parameters, x0=0, x1=1, y0=0, y1=1, container_name="Sine", Equation_px=[0, 0.1884057969], Equation_py=[0, 1])
graph_3 = GraphMapper(
    divide_5.Parameters,
    x0=0,
    x1=1,
    y0=0,
    y1=1,
    container_name="Sine",
    Equation_px=[0, 1],
    Equation_py=[0.289855063, 0.741496563])
graph_4 = GraphMapper(
    divide_5.Parameters,
    x0=0,
    x1=1,
    y0=0,
    y1=1,
    container_name="Bezier",
    cpx=[0, 0.885338366, 0.1616541296, 1],
    cpy=[0, 0, 1, 1])
graph_5 = GraphMapper(divide_5.Parameters, x0=0, x1=1, y0=0, y1=1, container_name="Sine", Equation_px=[0.009398495778, 1], Equation_py=[0, 1])
repeat = RepeatData(Data=panel_3, Length=lng)  # -> graft(Data)
curvepoint = PointOnCurve(dash.Gaps, parameter=0.5)
not = GateNot(A=repeat)
lng_2 = ListLength(List=divide_5.Parameters)  # -> expr("x-1", Length)
merge_6 = Merge(Data1=repeat, Data2=not)
cir = Circle(Plane=curvepoint, Radius=Slider(0.138, range=0..1))
shatter = Shatter(Curve=graft(cull_i), Parameters=graph_4)
repeat_2 = RepeatData(Data=merge_6, Length=lng_2)
dispatch = Dispatch(List=shatter, DispatchPattern=repeat_2)  # -> ListA, ListB
crv_7 = Curve(dispatch.ListA)
