# Grasshopper definition 04_GcodeExporter.gh (Grasshopper 0.9.76)
# Copyright: Co-de-iT
# plug-ins: Human

# GcodeExporter_v5.1
crv = Curve([<curve referenced from the Rhino model> x19])

list = ValueList({"2040": 0, "4070": 1, "60100": 2, "3MT": 3}, selected="2040")
list_2 = ValueList({"0.4", "0.7", "1.2", "3": 3.5}, selected="0.7")
z_up_mm = Slider(1, range=0..100)
extrusion_multiplier = Slider(1, range=0..6)
layer_heights_mm = Slider(1, range=0..20)
offset_from_the_plate_mm = Slider(0.3, range=0..5)
line_factor_mm = Slider(0.5, range=0..100)
retraction_value_mm = Slider(2, range=-5..5)

extruder_temperature = Panel("250")
extrusion_speed = Panel("700")
travel_speed = Panel("4000")
steps_per_unit = Panel("80")
bed_temperature = Panel("0")
fan_speed = Panel("10")

# ----
# Geometry input
crv_2 = Curve(crv)

cluster = Cluster_2(
    A_5=steps_per_unit,
    x_5=steps_per_unit,
    A_4=bed_temperature,
    x_4=bed_temperature,
    A_3=extruder_temperature,
    x_3=extruder_temperature,
    A_6=extruder_temperature,
    x_6=fan_speed,
    A=layer_heights_mm,
    B=list_2,
    B_2=extrusion_multiplier,
    u=extrusion_speed,
    crv=crv_2,
    u_3=travel_speed,
    A_2=line_factor_mm,
    Z=z_up_mm,
    u_4=travel_speed,
    u_2=travel_speed,
    x=retraction_value_mm,
    x_2=retraction_value_mm)  # -> r, R, pt_2, V, r_2
panel = Panel(cluster.R)
cluster_2 = Cluster(L=cluster.r_2, L_2=cluster.r, P=cluster.r, i=list, i_2=list)  # -> number_slider_3, L_3, swatch_3, swatch_2, item_1, i_3, pl, number_slider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
vdisex = VectorDisplayEx(Point=simplify(cluster.pt_2), Vector=cluster.V, Colour=cluster_2.swatch_3, Width=cluster_2.number_slider_3)
preview = CustomPreview(Geometry=cluster_2.L_3, Shader=cluster_2.swatch_3)
previewlw = CustomPreviewLineweights(Geometry=cluster_2.pl, Shader=cluster_2.C, Thickness=cluster_2.number_slider_2, Absolute=False)
preview_2 = CustomPreview(Geometry=cluster_2.B, Shader=cluster_2.M)
dots = DotDisplay(Point=cluster_2.i_3, Colour=cluster_2.swatch_3, Size=cluster_2.number_slider)
dots_2 = DotDisplay(Point=cluster_2.item_1, Colour=cluster_2.swatch_2, Size=cluster_2.number_slider)

# ----
# Output_Gcode
custom_subdir = Panel("Gcode_grasshopper")
file_name = Panel("ws_accademia_test_00.gcode")
dir_type = ValueList({"desktop": 0, "documents": 1, "GH file path": 2, "C:": 3}, selected="GH file path")
save_gcode_file = Button()

f_pathg = PathGenerator(type=dir_type, subDir=custom_subdir)  # -> dir; inputs type: Int32, subDir: String
# ---------- f_pathg: C# ----------
                           /*
    froGH - a sparse collection of (in)utilities for Grasshopper

    Path Generator
    code by Alessio Erioli - value list generation based on code by James Ramsden

    froGH by Co-de-iT is licensed under a Creative Commons Attribution 4.0 International License.
    http://creativecommons.org/licenses/by/4.0/

    */
    initComp();


    String S = "";
    String root = "";
    String end = "\\";
    String eol = Environment.NewLine;

    // __________________ autoList part __________________

    // variable for the list
    Grasshopper.Kernel.Special.GH_ValueList vList;
    // tries to cast input as list
    try{

      // if the list is not the first parameter then change Input[0] to the corresponding value
      vList = (Grasshopper.Kernel.Special.GH_ValueList) Component.Params.Input[0].Sources[0];
      // Print("value list connected");
      // check if the list must be created
      //if (vList.NickName != "dir type"){
      if (!vList.NickName.Equals("dir type")){
        vList.ClearData();
        vList.ListItems.Clear();
        vList.NickName = "dir type";
        var item1 = new Grasshopper.Kernel.Special.GH_ValueListItem("desktop", "0");
        var item2 = new Grasshopper.Kernel.Special.GH_ValueListItem("documents", "1");
        var item3 = new Grasshopper.Kernel.Special.GH_ValueListItem("GH file path", "2");
        var item4 = new Grasshopper.Kernel.Special.GH_ValueListItem("C:", "3");
        vList.ListItems.Add(item1);
        vList.ListItems.Add(item2);
        vList.ListItems.Add(item3);
        vList.ListItems.Add(item4);

        vList.ListItems[0].Value.CastTo(out type);
      }
    }
    catch{
      // handles anything that is not a value list
    }


    switch(type){
      case 0:
        root = Environment.GetFolderPath(Environment.SpecialFolder.Desktop) + end;
        S = "Desktop";
        break;
      case 1:
        root = Environment.GetFolderPath(Environment.SpecialFolder.MyDocuments) + end;
        S = "Documents";
        break;
      case 2:
        GH_Document ghDoc = owner.OnPingDocument();

        if (ghDoc.IsFilePathDefined)
        {
          int nameLen = ghDoc.DisplayName.TrimEnd('*').Length + 3; // +3 accounts for the '.gh' extension
          int fileLen = ghDoc.FilePath.TrimEnd('*').Length;

          //F = ghDoc.DisplayName.TrimEnd('*');
          root = ghDoc.FilePath.Substring(0, fileLen - nameLen);
          //root = gh_d.FilePath;
          S = "GH File path";
        }
        else
        {
          Print("No path defined. Saving to Desktop until then");
          root = Environment.GetFolderPath(Environment.SpecialFolder.Desktop);
          S = "Desktop";
        }
        break;
      case 3:
        root = "C:" + end;
        S = root + end;
        break;
    }
    dir = root + (subDir != null ? (subDir + end) : "");
    Component.Message = S;
# ---------- f_pathg: C# additional code ----------
  void initComp(){
    Component.Name = "Path Generator";
    Component.NickName = "f_PathG";
    Component.Description = "generates a path based on local direcories such as Desktop, Documents, GH file path";
    Component.Params.Input[0].Name = "dir type";
    Component.Params.Input[0].Description = "directory type: 0 desktop, 1 documents, 2 GH file path, 3 C:\nconnect a value list for automatic list generation";
    Component.Params.Input[1].Name = "custom subdir";
    Component.Params.Input[1].Description = "(optional) custom subdirectory";
  }
# ---------- end f_pathg ----------
f_str2file = SaveStringToFile(S=cluster.R, dir=f_pathg, file=file_name, save=save_gcode_file)  # -> info; inputs S: list of String, dir: String, file: String, save: Boolean
# ---------- f_str2file: C# ----------
                           /*
    froGH - a sparse collection of (in)utilities for Grasshopper

    Save string to file

    code by Alessio Erioli

    froGH by Co-de-iT is licensed under a Creative Commons Attribution 4.0 International License.
    http://creativecommons.org/licenses/by/4.0/

    */

    initComp();



    if (save){
      if (!Directory.Exists(dir)) Directory.CreateDirectory(dir);

      String target = dir + file;

      System.IO.File.WriteAllLines(target, S.ToArray());
      info = "file saved as: " + target;
    } else {
      info = "press save button to save file";
    }
# ---------- f_str2file: C# additional code ----------
  void initComp(){
    Component.Name = "Save String to File";
    Component.NickName = "f_Str2File";
    Component.Description = "Saves a text sequence to a file";

    Component.Params.Input[0].Name = "String";
    Component.Params.Input[0].Description = "string to save (as List)";
    Component.Params.Input[1].Name = "directory";
    Component.Params.Input[1].Description = "directory where the string file is saved";
    Component.Params.Input[2].Name = "fileName";
    Component.Params.Input[2].Description = "file name and extension (ex: myText.txt)";
    Component.Params.Input[3].Name = "save";
    Component.Params.Input[3].Description = "activate saving - attach a button and click to save";
    Component.Params.Output[0].Name = "info";
    Component.Params.Output[0].Description = "information on the saving process";
  }
# ---------- end f_str2file ----------

message = Panel(f_str2file)
directory = Panel(f_pathg)

# ==== cluster Cluster
L = ClusterInput()
P = ClusterInput()
i = ClusterInput()
i_2 = ClusterInput()
duppt = RemoveDuplicatePts(Points=P, Tolerance=0.01)
L_2 = ClusterInput()

# ----
# Display
item = ListItem(List=L, Index=0, Wrap=True)  # -> flatten(Item), flatten(Item1)
panel = Panel("""200
400
600
1000""")
panel_2 = Panel("""400
700
1000
1000""")
shift = ShiftList(List=item.Item, Shift=1, Wrap=True)
xy = XYPlane(Origin=Point(0, 0, 0))
item_2 = ListItem(List=panel, Index=i, Wrap=True)
item_3 = ListItem(List=panel_2, Index=i_2, Wrap=True)
pline = PolyLine(Vertices=duppt, Closed=False)
ln = Line(StartPoint=shift, EndPoint=item.Item1)
cyl = Cylinder(Base=xy, Radius=expr("x/2", item_2), Length=item_3)
lng = ListLength(List=ln)
swatch = ColourSwatch(SwatchColor=RGB(14, 35, 120))
cap = CapHoles(Brep=cyl)
cull_i = CullIndex(List=ln, Indices=expr("x-1", lng), Wrap=True)
item_4 = ListItem(List=L_2, Index=0, Wrap=True)  # -> Item1, Item
material = CreateMaterial(Diffuse=swatch, Specular=swatch, Emission=RGB(0, 0, 0), Transparency=Slider(0.903, range=0..1), Shine=0)

tstat = TreeStatistics(Tree=pline)  # -> Paths, Length, Count
range = Range(Domain=Domain(0, 1), Steps=expr("x-1", tstat.Count))  # -> graft(Range)
equals = Equality(FirstNumber=tstat.Count, SecondNumber=1)  # -> Equality, Inequality
filter = StreamFilter(Gate=equals.Equality, Stream0=range, Stream1="0")
pl = ClusterOutput(pline)
gradient = Gradient(LowerLimit=0, UpperLimit=1, Parameter=filter, stops=[0.0345: RGB(137, 205, 240), 0.98: RGB(14, 26, 76)])
swatch_2 = ClusterOutput(swatch)
swatch_3 = ClusterOutput(ColourSwatch(SwatchColor=RGB(255, 255, 255)))
B = ClusterOutput(cap)
L_3 = ClusterOutput(cull_i)
number_slider = ClusterOutput(Slider(2.3, range=0..5))
item_1 = ClusterOutput(item_4.Item1)
i_3 = ClusterOutput(item_4.Item)
number_slider_2 = ClusterOutput(Slider(2.7, range=0..5))
M = ClusterOutput(material)
number_slider_3 = ClusterOutput(Slider(2, range=0..2))
C = ClusterOutput(gradient)

# ==== cluster Cluster_2
crv = ClusterInput()

crv_2 = Curve(crv)
curvepoint = PointOnCurve(crv_2, parameter=0.5)
pdecon = Deconstruct(Point=curvepoint)  # -> XComponent, YComponent, ZComponent
sort = SortList(Keys=pdecon.ZComponent, ValuesA=crv_2)  # -> Keys, ValuesA
cset = CreateSet(List=sort.Keys)  # -> graft(Set), Map
equals = Equality(FirstNumber=sort.Keys, SecondNumber=cset.Set)  # -> Equality, Inequality
cull = CullPattern(List=sort.ValuesA, CullPattern=equals.Equality)

A = ClusterInput()
B = ClusterInput()
B_2 = ClusterInput()

multiplication = Multiplication(A=A, B=B)
pi = Pi(Factor=1)
division = Division(A="1.75", B="2")
pow = Power(A=division, B="2")
multiplication_2 = Multiplication(A=pi, B=pow)
division_2 = Division(A=multiplication, B=multiplication_2)
multiplication_3 = Multiplication(A=division_2, B=B_2)
e_value = Panel(multiplication_3)

A_2 = ClusterInput()
Z = ClusterInput()
u = ClusterInput()
x = ClusterInput()

azzera_la_lunghezza_di_estrusione = Text("G92 E0")

x_2 = ClusterInput()
u_2 = ClusterInput()
u_3 = ClusterInput()
u_4 = ClusterInput()
x_3 = ClusterInput()
x_4 = ClusterInput()
x_5 = ClusterInput()
x_6 = ClusterInput()
A_3 = ClusterInput()
A_4 = ClusterInput()
A_5 = ClusterInput()
A_6 = ClusterInput()

# ----
# start
expression = Expression(x=x_3, Expression="Format(\"M109 S{0}\", x)")
expression_2 = Expression(x=x_4, Expression="Format(\"M190 S{0}\", x)")
expression_3 = Expression(x=x_5, Expression="Format(\"M92 E{0}\", x)")
expression_4 = Expression(x=x_6, Expression="Format(\"M106 S{0}\", x)")
larger = LargerThan(FirstNumber=A_3, SecondNumber=1)  # -> LargerThan, OrEqualTo
larger_2 = LargerThan(FirstNumber=A_4, SecondNumber=1)  # -> LargerThan, OrEqualTo
larger_3 = LargerThan(FirstNumber=A_5, SecondNumber=1)  # -> LargerThan, OrEqualTo
larger_4 = LargerThan(FirstNumber=A_6, SecondNumber=1)  # -> LargerThan, OrEqualTo
filter = StreamFilter(Gate=larger_4.LargerThan, Stream0=";Fan off", Stream1=expression_4)
filter_2 = StreamFilter(Gate=larger.LargerThan, Stream0=";Cold Extruder", Stream1=expression)
filter_3 = StreamFilter(Gate=larger_2.LargerThan, Stream0=";Cold Bed", Stream1=expression_2)
filter_4 = StreamFilter(Gate=larger_3.LargerThan, Stream0=";Default steps", Stream1=expression_3)
panel = Panel("""T0
G21             ;metric values
G90              ;absolute positioning
M82            ;set extruder to absolute mode
M107          ;start with the fan off
G28 X0 Y0     ;move X/Y to min endstops
G28 Z0        ;move Z to min endstops
G1 Z15.0 F9000    ;move the platform down 15mm
G92 E0                  ;zero the extruded length
G1 F200 E6              ;extrude 3mm of feed stock
G92 E0                  ;zero the extruded length again
M117 Printing...      ;Put printing message on LCD screen""")
merge = Merge(Data1=flatten(filter_4), Data2=flatten(filter_3), Data3=flatten(filter_2), Data4=flatten(panel), Data5=flatten(filter))

# ----
# end
panel_2 = Panel(""";End GCode
M104 S0  ;extruder heater off
M140 S0  ;heated bed heater off (if you have it)
G91  ;relative positioning
G1 E-1 F300   ;retract the filament a bit
G1 Z+1 E-5 F9000 ;move Z up a bit and retract filament even more
M107  ;fan off
G28 X0 Y0  ;move X/Y to min endstops, so the head is out of the way
;M84                         ;steppers off
G90                         ;absolute positioning""")

topoly = CurveToPolyline(Curve=cull, ToleranceDistance=0, ToleranceAngle=Slider(0.08, range=0..1))  # -> Polyline, Segments
crv_3 = Curve(flatten(topoly.Polyline))
explode = Explode(Curve=crv_3, Recursive=True)  # -> Segments, Vertices
vec = Vector(explode.Segments)
panel_3 = Panel("{Round(x,u),Round(y,u),Round(z,u)}")
slider = Slider(2, range=0..10)
item = ListItem(List=vec, Index=0, Wrap=True)  # -> Item1, Item
pdecon_2 = Deconstruct(Point=explode.Vertices)  # -> XComponent, YComponent, ZComponent
neg = Negative(Value=item.Item)
len = Length(Curve=explode.Segments)
vec_2 = Vector([neg, item.Item1])
ins = InsertItems(List=len, Item=0, Indices=0, Wrap=True)
amp = Amplitude(Vector=vec_2, Amplitude=A_2)
eval = Evaluate(F=panel_3, x=pdecon_2.XComponent, y=pdecon_2.YComponent, z=pdecon_2.ZComponent, u=slider)
devec = DeconstructVector(Vector=amp)  # -> XComponent, YComponent, ZComponent
item_2 = ListItem(List=eval, Index=0, Wrap=True)  # -> Item1, Item
vec_3 = VectorXYZ(XComponent=devec.XComponent, YComponent=devec.YComponent, ZComponent=Z)  # -> Vector, Length
pt = Point([item_2.Item, item_2.Item1])
eval_2 = Evaluate(F="Round(x,y)", x=ins, y=slider)
move = Move(Geometry=pt, Motion=vec_3.Vector)  # -> Geometry, Transform
multiplication_4 = Multiplication(A=eval_2, B=multiplication_3)
pdecon_3 = Deconstruct(Point=move.Geometry)  # -> XComponent, YComponent, ZComponent
pdecon_4 = Deconstruct(Point=eval)  # -> XComponent, YComponent, ZComponent
ma = MassAddition(Input=multiplication_4)  # -> Result, PartialResults
eval_3 = Evaluate(F=panel_3, x=pdecon_3.XComponent, y=pdecon_3.YComponent, z=pdecon_3.ZComponent, u=slider)
item_3 = ListItem(List=eval_3, Index=0, Wrap=True)  # -> Item, Item1
item_4 = ListItem(List=pt, Index=0, Wrap=True)  # -> Item, Item1
expression_5 = Expression(
    x=pdecon_4.XComponent,
    y=pdecon_4.YComponent,
    z=pdecon_4.ZComponent,
    u=u,
    v=ma.PartialResults,
    Expression="Format(\"G1 F{3} X{0} Y{1} Z{2} E{4}\", x, y, z, u, v)")
neg_2 = Negative(Value=x)
pdecon_5 = Deconstruct(Point=item_3.Item1)  # -> XComponent, YComponent, ZComponent
pdecon_6 = Deconstruct(Point=item_4.Item)  # -> XComponent, YComponent, ZComponent
pdecon_7 = Deconstruct(Point=item_3.Item)  # -> XComponent, YComponent, ZComponent
expression_6 = Expression(x=x_2, Expression="Format(\"G1 E{0}\", x)")
expression_7 = Expression(
    x=pdecon_5.XComponent,
    y=pdecon_5.YComponent,
    z=pdecon_5.ZComponent,
    u=u_2,
    v=neg_2,
    Expression="Format(\"G1 F{3} X{0} Y{1} Z{2} E{4}\", x, y, z, u, v)")
expression_8 = Expression(
    x=pdecon_6.XComponent,
    y=pdecon_6.YComponent,
    z=pdecon_6.ZComponent,
    u=u_3,
    Expression="Format(\"G1 F{3} X{0} Y{1} Z{2}\", x, y, z, u)")
expression_9 = Expression(
    x=pdecon_7.XComponent,
    y=pdecon_7.YComponent,
    z=pdecon_7.ZComponent,
    u=u_4,
    Expression="Format(\"G1 F{3} X{0} Y{1} Z{2}\", x, y, z, u)")
lng = ListLength(List=expression_5)  # -> expr("x", Length)
lng_2 = ListLength(List=lng)
dup = DuplicateData(Data="0", Number=lng_2, Order=True)
dup_2 = DuplicateData(Data=azzera_la_lunghezza_di_estrusione, Number=lng_2, Order=True)
dup_3 = DuplicateData(Data=expression_6, Number=lng_2, Order=True)
merge_2 = Merge(Data1=simplify(dup), Data2=simplify(lng))
lng_3 = ListLength(List=crv_3)
larger_5 = LargerThan(FirstNumber=lng_3, SecondNumber=Slider(1, range=0..1))  # -> LargerThan, OrEqualTo
entwine = Entwine(
    Branch00=expression_9,
    Branch01=expression_8,
    Branch02=dup_3,
    Branch03=dup_2,
    Branch04=expression_5,
    Branch05=dup_2,
    Branch06=expression_7,
    Branch07=dup_2,
    FlattenInputs=True)  # -> flatten(Result)
merge_3 = Merge(
    Data1=simplify(expression_9),
    Data2=simplify(expression_8),
    Data3=simplify(dup_3),
    Data4=simplify(dup_2),
    Data5=simplify(expression_5),
    Data6=simplify(dup_2),
    Data7=simplify(expression_7),
    Data8=simplify(dup_2))
filter_5 = StreamFilter(Gate=larger_5.LargerThan, Stream0=entwine, Stream1=merge_3)
txt = Text(flatten(filter_5))
merge_4 = Merge(Data1=merge, Data2=txt, Data3=panel_2)
panel_4 = Panel(merge_4)

r = ClusterOutput(eval)
V = ClusterOutput(vec_3.Vector)
pt_2 = ClusterOutput(pt)
r_2 = ClusterOutput(eval_3)
R = ClusterOutput(merge_4)
