# Grasshopper definition XX_Voronoi_relax.gh (Grasshopper 0.9.76)
# Copyright: Co-de-iT
# plug-ins: Sandbox Topology, Anemone, Kangaroo2 Components

# Flexible Bodies
# tutors: Alessio Erioli - Lapo Naldoni
# ABABO . May 2017
print_bed_radius = Slider(100, range=0..100)
initial_population = Slider(51, range=50..200)

# ---- group: attractor curves
crv = Curve([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])

# ----
divisions = Slider(50, range=50..200)
points_for_each_division = Slider(2, range=2..10)
# generates a dust of points around attractor curves
max_expansion = Slider(12, range=0..20)
divide = DivideCurve(Curve=crv, Count=divisions, Kinks=False)  # -> graft(Points), Tangents, Parameters
lng = ListLength(List=flatten(divide.Points))
random = Random(Range="0 to 100", Number=lng, Seed=2, Integers=True)  # -> graft(Random)
random_2 = Random(Range=Domain(0, 1), Number=points_for_each_division, Seed=random)
multiplication = Multiplication(A=random_2, B="2")
Z = UnitZ(Factor=1)
X = UnitX(Factor=1)
pi = Pi(Factor=multiplication)
vrot = Rotate(Vector=X, Axis=Z, Angle=pi)
random_3 = Random(Range=Domain(0, 1), Number=points_for_each_division, Seed=2)
multiplication_2 = Multiplication(A=random_3, B=max_expansion)
multiplication_3 = Multiplication(A=vrot, B=multiplication_2)
move = Move(Geometry=divide.Points, Motion=multiplication_3)  # -> Geometry, Transform

neg = Negative(Value=print_bed_radius)
dom = ConstructDomain(DomainStart=neg, DomainEnd=print_bed_radius)
# Voronoi relax
# 
# A variation of the classic Voronoi with curve densifiers and relaxation
# 
# tiny changes to a Voronoi by Alessio Erioli
# 
# v 0.1
# 
# © Co-de-iT 2017 _ Creative Commons Attribution-NonCommercial-ShareAlike 4.0 International License
cir = Circle(Plane=PlaneXY(0, 0, 0), Radius=print_bed_radius)
rectangle = Rectangle(Plane=PlaneXY(0, 0, 0), XSize=dom, YSize=dom, Radius=0)  # -> Rectangle, Length
pop2d = Populate2D(Region=rectangle.Rectangle, Count=initial_population, Seed=1)
incurve = PointInCurve(Point=pop2d, Curve=cir)  # -> Relationship, Point
larger = LargerThan(FirstNumber=incurve.Relationship, SecondNumber=0)  # -> LargerThan, OrEqualTo
dispatch = Dispatch(List=pop2d, DispatchPattern=larger.LargerThan)  # -> ListA, ListB
merge = Merge(Data1=dispatch.ListA, Data2=move.Geometry)  # -> flatten(Result)

# ----
# ye olde Voronoi algorithm
voronoi = Voronoi(Points=merge, Boundary=rectangle.Rectangle, BruteForceOverride=False)

number_slider = Slider(10, range=1..10)
# clean curve network
trim = TrimWithRegion(Curve=voronoi, Region=cir)  # -> flatten(Inside), Outside
scale = Scale(Geometry=trim.Inside, Center=Point(0, 0, 0), Factor=number_slider)  # -> Geometry, Transform
explode = Explode(Curve=scale.Geometry, Recursive=True)  # -> flatten(Segments), Vertices
dupln = RemoveDuplicateLines(Lines=explode.Segments, Tolerance=0.01)

# ----
# Lloyd's algorithm
number_slider_2 = Slider(100, range=0..100)
start = Button()
loop_start = LoopStart(N=number_slider_2, T=start, D0=voronoi, D1=graft(merge))  # -> port, Counter, Data, Data_2
pcen = PolygonCenter(Polyline=loop_start.Data)  # -> CenterV, CenterE, CenterA
merge_2 = Merge(Data1=simplify(loop_start.Data_2), Data2=simplify(graft(pcen.CenterV)))
voronoi_2 = Voronoi(Points=pcen.CenterV, Boundary=rectangle.Rectangle, BruteForceOverride=False)
loop_end = LoopEnd(
    port=loop_start.port,
    Exit=False,
    Data=voronoi_2,
    Data_2=merge_2,
    pausedState=False,
    state="Constant output",
    TimeOutVal=0)  # -> D0, D1
trim_2 = TrimWithRegion(Curve=loop_end.D0, Region=cir)  # -> flatten(Inside), Outside
crv_2 = Curve(trim_2.Inside)

# ----
# relax network
line_topo = LineTopology(ListOfLines=dupln, Tolerance=0.001)  # -> ListOfPoints, LinePointStructure, PointPointStructure, PointLineStructure
lng_2 = ListLength(List=line_topo.PointPointStructure)  # -> flatten(Length)
equals = Equality(FirstNumber=lng_2, SecondNumber="1")  # -> Equality, Inequality
len = Length(Curve=dupln)
dispatch_2 = Dispatch(List=line_topo.ListOfPoints, DispatchPattern=equals.Equality)  # -> ListA, ListB
multiplication_4 = Multiplication(A=len, B=Slider(0.5, range=0..1))
anchor = Anchor(Point=dispatch_2.ListA, Strength=Slider(100000, range=0..100000))
length_line = LengthLine(Line=dupln, Length=multiplication_4, Strength=10)
merge_3 = Merge(Data1=anchor, Data2=length_line)
solver = Solver(GoalObjects=merge_3, Reset=Button(), Threshold=1e-15, Tolerance=Slider(0.0001, range=0..0.0001), On=Toggle(False))  # -> I, V, O
unflatten = UnflattenTree(Tree=solver.O, Guide=merge_3)
one_over_x = OneOverX(Value=number_slider)
f_sbpath = SerialBranchPath(T=unflatten, i="0")  # -> P, D; inputs T: tree, i: Int32
# ---------- f_sbpath: C# ----------
                                            /*
    froGH - a sparse collection of (in)utilities for Grasshopper

    Serial Branch Path
    code by Alessio Erioli

    froGH by Co-de-iT is licensed under a Creative Commons Attribution 4.0 International License.
    http://creativecommons.org/licenses/by/4.0/

    */

    initComp();


    if (T.BranchCount > 0){
      int ind = i % T.BranchCount;
      P = T.Path(ind);
      D = T.Branches[ind];
    }
# ---------- f_sbpath: C# additional code ----------
  void initComp(){
    Component.Name = "Serial Branch Path";
    Component.NickName = "f_SBPath";
    Component.Description = "Retrieves the data tree path and data for a specific branch serial index";
    Component.Params.Input[0].Name = "Tree";
    Component.Params.Input[0].Description = "the data tree";
    Component.Params.Input[1].Name = "index";
    Component.Params.Input[1].Description = "serial index of branch to sample";
    Component.Params.Output[0].Name = "Path";
    Component.Params.Output[0].Description = "the tree branch path";
    Component.Params.Output[1].Name = "Data";
    Component.Params.Output[1].Description = "the tree branch content";
  }
# ---------- end f_sbpath ----------
scale_2 = Scale(Geometry=f_sbpath.D, Center=Point(0, 0, 0), Factor=one_over_x)  # -> Geometry, Transform

# ----
# clean curve network
explode_2 = Explode(Curve=trim_2.Inside, Recursive=True)  # -> flatten(Segments), Vertices
dupln_2 = RemoveDuplicateLines(Lines=explode_2.Segments, Tolerance=0.01)

relaxation_method = ValueList({"Lloyd's algorithm": 0, "Kangaroo": 1}, selected="Kangaroo")

filter = StreamFilter(Gate=relaxation_method, Stream0=dupln_2, Stream1=scale_2.Geometry)
lng_3 = ListLength(List=filter)

# ----
# sort curves for print
# x/y sorting
eval = EvaluateCurve(Curve=reparameterize(filter), Parameter="0.5")  # -> Point, Tangent, Angle
pdecon = Deconstruct(Point=eval.Point)  # -> XComponent, YComponent, ZComponent
div = DivideDomain(Domain="-100 to 100", Count=Slider(15, range=2..20))  # -> graft(Segments)
sort = SortList(Keys=pdecon.XComponent, ValuesA=eval.Point, ValuesB=filter)  # -> Keys, ValuesA, ValuesB
inc = Includes(Value=sort.Keys, Domain=div)  # -> Includes, Deviation
dispatch_3 = Dispatch(List=sort.ValuesB, DispatchPattern=inc.Includes)  # -> ListA, ListB
dispatch_4 = Dispatch(List=sort.ValuesA, DispatchPattern=inc.Includes)  # -> ListA, ListB
pdecon_2 = Deconstruct(Point=dispatch_4.ListA)  # -> XComponent, YComponent, ZComponent
sort_2 = SortList(Keys=pdecon_2.YComponent, ValuesA=dispatch_4.ListA, ValuesB=dispatch_3.ListA)  # -> Keys, ValuesA, ValuesB
panel = Panel("""true
false""")
tstat = TreeStatistics(Tree=sort_2.ValuesA)  # -> Paths, Length, Count
repeat = RepeatData(Data=panel, Length=tstat.Count)  # -> graft(Data)
dispatch_5 = Dispatch(List=sort_2.ValuesB, DispatchPattern=repeat)  # -> ListA, ListB
dispatch_6 = Dispatch(List=sort_2.ValuesA, DispatchPattern=repeat)  # -> ListA, ListB
rev = ReverseList(List=dispatch_5.ListA)
rev_2 = ReverseList(List=dispatch_6.ListA)
weave = Weave(Pattern=[0, 1], Stream0=rev, Stream1=dispatch_5.ListB, NullGaps=False)  # -> flatten(Weave)
weave_2 = Weave(Pattern=[0, 1], Stream0=rev_2, Stream1=dispatch_6.ListB, NullGaps=False)  # -> flatten(Weave)
crv_3 = Curve(weave)

# ----
# spiral sorting
# outward flip
end = EndPoints(Curve=filter)  # -> Start, End
# flips all curves so they are oriented outwards
# 
# . if end point is closer to the center than the start point, flip the curve
pt = Point(Point(0, 0, 0))
dist = Distance(PointA=end.Start, PointB=pt)
dist_2 = Distance(PointA=end.End, PointB=pt)
smaller = SmallerThan(FirstNumber=dist_2, SecondNumber=dist)  # -> SmallerThan, OrEqualTo
dispatch_7 = Dispatch(List=filter, DispatchPattern=smaller.SmallerThan)  # -> ListA, ListB
flip = FlipCurve(Curve=dispatch_7.ListA)  # -> Curve, Flag
weave_3 = Weave(Pattern=smaller.SmallerThan, Stream0=dispatch_7.ListB, Stream1=flip.Curve, NullGaps=False)

# ----
# spiral generator
spiral_turns = Slider(9.626, range=1..10)
print_radius_domain = Panel("0 to 100")
pi_2 = Pi(Factor=spiral_turns)
range = Range(Domain=print_radius_domain, Steps=expr("x-1", lng_3))
range_2 = Range(Domain=pi_2, Steps=expr("x-1", lng_3))
cos = Cosine(Value=range_2)
sin = Sine(Value=range_2)
multiplication_5 = Multiplication(A=range, B=cos)
multiplication_6 = Multiplication(A=range, B=sin)
pt_2 = ConstructPoint(XCoordinate=multiplication_5, YCoordinate=multiplication_6, ZCoordinate=0)

# ----
# sort curves along spiral
panel_2 = Panel("0.5")
eval_2 = EvaluateCurve(Curve=reparameterize(weave_3), Parameter=panel_2)  # -> Point, Tangent, Angle
cp = ClosestPoint(Point=eval_2.Point, Cloud=pt_2)  # -> ClosestPoint, CPIndex, Distance
sort_3 = SortList(Keys=cp.CPIndex, ValuesB=eval_2.Point, ValuesA=weave_3)  # -> Keys, ValuesB, ValuesA

lng_4 = ListLength(List=crv_3)
series = Series(Start=0, Step=1, Count=lng_4)
# display
number_slider_3 = Slider(0, range=0..1)
gradient = Gradient(LowerLimit=0, UpperLimit=expr("x-1", lng_4), Parameter=series, stops=[0.0345: RGB(137, 205, 240), 0.98: RGB(14, 26, 76)])
lng_5 = ListLength(List=crv_3)  # -> expr("x-1", Length)
multiplication_7 = Multiplication(A=lng_5, B=number_slider_3)
int = Integer(series)
# printing sequence (use slider)
subset = SubList(List=crv_3, Domain=multiplication_7, Wrap=True)  # -> List, Index
# sequence gradient display
preview = CustomPreview(Geometry=crv_3, Shader=gradient)
# ordered indexes
tag = TextTag3D(
    Location=weave_2,
    Text=int,
    Size=Slider(1.602, range=0..5),
    Colour=ColourSwatch(SwatchColor=RGB(255, 255, 255)),
    Justification=7)

crv_4 = Curve(sort_3.ValuesA)

pt_3 = Point(sort_3.ValuesB)
pline = PolyLine(Vertices=pt_3, Closed=False)
len_2 = Length(Curve=pline)

# ----
# bake this
merge_4 = Merge(Data1=cir, Data2=crv_3)

lng_6 = ListLength(List=crv_4)
series_2 = Series(Start=0, Step=1, Count=lng_6)
# display
number_slider_4 = Slider(0, range=0..1)
gradient_2 = Gradient(LowerLimit=0, UpperLimit=expr("x-1", lng_6), Parameter=series_2, stops=[0: RGB(14, 26, 76), 1: RGB(237, 249, 255)])
lng_7 = ListLength(List=crv_4)  # -> expr("x-1", Length)
multiplication_8 = Multiplication(A=lng_7, B=number_slider_4)
int_2 = Integer(series_2)
# printing sequence (use slider)
subset_2 = SubList(List=crv_4, Domain=multiplication_8, Wrap=True)  # -> List, Index
# sequence gradient display
preview_2 = CustomPreview(Geometry=crv_4, Shader=gradient_2)
# ordered indexes
tag_2 = TextTag3D(
    Location=pt_3,
    Text=int_2,
    Size=Slider(1.602, range=0..5),
    Colour=ColourSwatch(SwatchColor=RGB(255, 255, 255)),
    Justification=7)

# ----
# GA to minimize print time: Tries to minimize the length of the polyline joining all curves centers by changing the spiral turns parameter
galapagos = Galapagos(fitness=len_2, gene=spiral_turns)

# ----
# adjust circle seam
# puts the start/end of circle aligned with the end point of the last curve
item = ListItem(List=crv_4, Index=-1, Wrap=True)
end_2 = EndPoints(Curve=item)  # -> Start, End
crv_cp = CurveClosestPoint(Point=end_2.End, Curve=cir)  # -> Point, Parameter, Distance
seam = Seam(Curve=cir, Seam=crv_cp.Parameter)

# ----
# bake this
merge_5 = Merge(Data1=seam, Data2=crv_4)
